# Dynamo graph 2ImportGEFFile.dyn (Dynamo 0.9.0.3067)

file_path = Filename("\\nas-BE-94-5F\3bm\50_projecten\378_Groentewinkel_In_de_Bogaard_Dordrecht\378_40_terrein\24026_1.GEF")
readText = File.ReadText(file_path)
watch = Watch(readText)
string = StringInput("#EOH=")
split = String.Split(watch, string)
lastItem = List.LastItem(split)
watch_2 = Watch(lastItem)
family_types = FamilyTypes()
number = DoubleInput(0)
number_2 = DoubleInput(10)
string_2 = StringInput("\n")
split_2 = String.Split(lastItem, string_2)
string_3 = StringInput(" ")
split_3 = String.Split(split_2, string_3)
transpose = List.Transpose(split_3)
integer_slider = IntegerSlider(0, range=0..100 step 1)
getItemAtIndex = List.GetItemAtIndex(list=transpose, index=integer_slider)
string_4 = StringInput("e")
split_4 = String.Split(getItemAtIndex, string_4)
transpose_2 = List.Transpose(split_4)
lastItem_2 = List.LastItem(transpose_2)
toNumber = String.ToNumber(lastItem_2)
pow = Math.Pow(number=number_2, power=toNumber)
firstItem = List.FirstItem(transpose_2)
toNumber_2 = String.ToNumber(firstItem)
depthInMeters = pow * toNumber_2
number_3 = DoubleInput(1000)
depthInMM = depthInMeters * number_3
number_4 = DoubleInput(-1)
depth = depthInMM * number_4
byCoordinates = FamilyInstance.ByCoordinates(family_types, number, number, depth)
string_5 = StringInput("Thickness")
integer_slider_2 = IntegerSlider(0, range=0..100 step 1)
removeItemAtIndex = List.RemoveItemAtIndex(list=depthInMM, indices=integer_slider_2)
thickness = removeItemAtIndex - depthInMM
setParameterByName = Element.SetParameterByName(element=byCoordinates, parameterName=string_5, value=thickness)
string_6 = StringInput("Material")
number_5 = DoubleInput(10)
watch_3 = Watch(transpose)
integer_slider_3 = IntegerSlider(7, range=0..100 step 1)
getItemAtIndex_2 = List.GetItemAtIndex(list=watch_3, index=integer_slider_3)
string_7 = StringInput("e")
split_5 = String.Split(getItemAtIndex_2, string_7)
transpose_3 = List.Transpose(split_5)
lastItem_3 = List.LastItem(transpose_3)
toNumber_3 = String.ToNumber(lastItem_3)
pow_2 = Math.Pow(number=number_5, power=toNumber_3)
firstItem_2 = List.FirstItem(transpose_3)
toNumber_4 = String.ToNumber(firstItem_2)
frictionRatio = pow_2 * toNumber_4
fractionRatioPeat = DoubleInput(5)
lt = frictionRatio < fractionRatioPeat
fractionRatioClay = DoubleInput(2.5)
gt = frictionRatio > fractionRatioClay
lt_2 = frictionRatio < fractionRatioPeat
eq = gt == lt_2
string_8 = StringInput("90_klei")
fractionRatioSilt = DoubleInput(1)
gt_2 = frictionRatio > fractionRatioSilt
lt_3 = frictionRatio < fractionRatioClay
eq_2 = gt_2 == lt_3
string_9 = StringInput("90_silt")
lt_4 = frictionRatio < fractionRatioSilt
string_10 = StringInput("90_zand")
string_11 = StringInput("")
sandLayers = If(test=lt_4, true=string_10, false=string_11)
siltLayers = If(test=eq_2, true=string_9, false=sandLayers)
clayLayers = If(test=eq, true=string_8, false=siltLayers)
string_12 = StringInput("90_veen")
peatLayers = If(test=lt, true=clayLayers, false=string_12)
byName = Material.ByName(peatLayers)
setParameterByName_2 = Element.SetParameterByName(element=byCoordinates, parameterName=string_6, value=byName)
fractionRatioSand = DoubleInput(0.2)
code_block = CodeBlock {  }
